# Grasshopper definition GH_Test_Bench.ghx (Grasshopper 1.0.7)
# Copyright: Felix Brunold

# ---- group: Test Group Name
xy_plane = XYPlane(Origin=Point(0, 0, 0))
int = Slider(10, range=0..30)
decimal = Slider(12.5, range=0..30)
plane = Plane(xy_plane)
rectangle = Rectangle(Plane=plane, XSize=int, YSize=decimal, Radius=0)  # -> Rectangle, Length
number = Number([int, decimal])

# ----
panelinput = Panel("Panel Data")
number_slider_name_1 = Slider(10, range=10..30)
number_slider_name_1_2 = Slider(20, range=10..30)
paneloutput = Panel(panelinput)
cluster = Cluster(A=number_slider_name_1, B=number_slider_name_1_2)
z = Panel("10")
unit_z = UnitZ(Factor=z)
extrude = Extrude(Base=rectangle.Rectangle, Direction=unit_z)

# ==== cluster Cluster
A = ClusterInput()
B = ClusterInput()
addition = Addition(A=A, B=B)
multiplication = Multiplication(A=addition, B=2)
result = ClusterOutput(multiplication)
