# Grasshopper definition Orbb.ghx (Grasshopper 1.0.7)
# Copyright: Felix Brunold
# plug-ins: LunchBox, Human

construct_point = ConstructPoint(XCoordinate=0, YCoordinate=0, ZCoordinate=0)
basepoint_p2 = Point(construct_point)

materialdicke = Slider(1, range=0.5..2.5)
werkzeugradius = Slider(1.5, range=0.5..2.5)
radnietloch = Slider(1, range=0.1..5)
werkzeugradius_2 = Number(werkzeugradius)
materialdicke_2 = Number(materialdicke)
radnietloch_2 = Number(radnietloch)

ls1 = Slider(15, range=0..15)
ls2 = Slider(100, range=30..120)
ls3 = Slider(25, range=10..120)
ls4 = Slider(60, range=30..120)
ls5 = Slider(120, range=65..120)
ls6 = Slider(66, range=30..120)
ls7 = Slider(110, range=30..120)
ls8 = Slider(15, range=10..20)
ls4_2 = Number(ls4)
ls1_2 = Number(ls1)
ls2_2 = Number(ls2)
ls3_2 = Number(ls3)
ls5_2 = Number(ls5)
ls6_2 = Number(ls6)
ls7_2 = Number(ls7)
ls8_2 = Number(ls8)

t1 = Slider(378, range=10..1040)
angle = Slider(124, range=95..160)
lasche1 = Slider(30, range=10..40)
lasche2 = Slider(15, range=5..20)
lasche3 = Slider(15, range=4..40)
lasche4 = Slider(10, range=0..30)
lasche5 = Slider(15, range=10..20)
angle_2 = Number(expr("180-x", angle))
llasche1 = Number(lasche1)
llasche2 = Number(lasche2)
llasche3 = Number(lasche3)
llasche4 = Number(lasche4)
llasche5 = Number(lasche5)
t1_2 = Number(t1)

lineshortening = Slider(-0.05, range=-1..0)
lineshortening_2 = Number(lineshortening)

basepoint_p2_2 = Point(basepoint_p2)
ls2_3 = Number(ls2_2)
unit_x = UnitX(Factor=ls2_3)
move = Move(Geometry=basepoint_p2_2, Motion=unit_x)  # -> Geometry, Transform
p3 = Point(move.Geometry)

basepoint_p2_3 = Point(basepoint_p2)
ls1_3 = Number(ls1_2)
unit_x_2 = UnitX(Factor=ls1_3)
unit_y = UnitY(Factor=1)
rotate = Rotate(Vector=unit_x_2, Axis=expr("-x", unit_y), Angle=degrees("5"))
move_2 = Move(Geometry=basepoint_p2_3, Motion=rotate)  # -> Geometry, Transform
p1 = Point(move_2.Geometry)

p3_2 = Point(p3)
ls3_3 = Number(ls3_2)
unit_z = UnitZ(Factor=ls3_3)
move_3 = Move(Geometry=p3_2, Motion=expr("-x", unit_z))  # -> Geometry, Transform
p4 = Point(move_3.Geometry)

p4_2 = Point(p4)
ls4_3 = Number(ls4_2)
unit_x_3 = UnitX(Factor=ls4_3)
move_4 = Move(Geometry=p4_2, Motion=unit_x_3)  # -> Geometry, Transform
p5 = Point(move_4.Geometry)

p5_2 = Point(p5)
ls5_3 = Number(ls5_2)
unit_z_2 = UnitZ(Factor=ls5_3)
move_5 = Move(Geometry=p5_2, Motion=unit_z_2)  # -> Geometry, Transform
p6 = Point(move_5.Geometry)

p6_2 = Point(p6)
ls6_3 = Number(ls6_2)
unit_x_4 = UnitX(Factor=ls6_3)
move_6 = Move(Geometry=p6_2, Motion=unit_x_4)  # -> Geometry, Transform
p7 = Point(move_6.Geometry)

p7_2 = Point(p7)
ls7_3 = Number(ls7_2)
unit_z_3 = UnitZ(Factor=ls7_3)  # -> expr("-x", UnitVector)
move_7 = Move(Geometry=p7_2, Motion=unit_z_3)  # -> Geometry, Transform
p8 = Point(move_7.Geometry)

ls8_3 = Number(ls8_2)
p8_2 = Point(p8)
unit_x_5 = UnitX(Factor=ls8_3)  # -> expr("-x", UnitVector)
unit_y_2 = UnitY(Factor=1)
angle_3 = Panel("45")
rotate_2 = Rotate(Vector=unit_x_5, Axis=unit_y_2, Angle=degrees(angle_3))
move_8 = Move(Geometry=p8_2, Motion=rotate_2)  # -> Geometry, Transform
p9 = Point(move_8.Geometry)

p1_2 = Point(p1)
basepoint_p2_4 = Point(basepoint_p2)
p3_3 = Point(p3)
p4_3 = Point(p4)
p5_3 = Point(p5)
p6_3 = Point(p6)
p7_3 = Point(p7)
p9_2 = Point(p9)
p8_3 = Point(p8)
merge = Merge(Data1=p1_2, Data2=basepoint_p2_4, Data3=p3_3, Data4=p4_3, Data5=p5_3, Data6=p6_3, Data7=p7_3, Data8=p8_3, Data9=p9_2)
polyline = PolyLine(Vertices=merge, Closed=False)
baseprofile = Curve(polyline)

werkzeugradius_3 = Number(werkzeugradius_2)
baseprofile_2 = Curve(polyline)
materialdicke_3 = Number(materialdicke_2)
c_script = CSharpScript(baseCrv=baseprofile_2, t=materialdicke_3, rw=werkzeugradius_3)  # -> shCurve; inputs baseCrv: Curve, t: Double, rw: Double
# ---------- c_script: C# ----------
if (rw == 0){
        rw = 1.5;
    }

    var explodedCrv = baseCrv.DuplicateSegments();

    var allLenghts = new List<double>();
    var allTangents = new List<Vector3d>();
    var allAngles = new List<double>();

    var plane  = Vector3d.YAxis;

    foreach (var crv in explodedCrv){
        allTangents.Add(crv.TangentAt(crv.GetLength()/2));
        allLenghts.Add(crv.GetLength());
    }

    for (int i= 0; i < allTangents.Count -1; i++){
        Vector3d t1 = allTangents[i+1];
        Vector3d t2 = allTangents[i];
        
        double currentAngle = Vector3d.VectorAngle(t1,t2, plane);
        allAngles.Add(ToDeg(currentAngle));

    }

    var shortensVactors = Shorten(rw, t, allAngles);


    var shorenedCurves = new List<Curve>();

    for (int i = 0; i < explodedCrv.Length; i++)
    {
        double shortenAmount = shortensVactors[i];
        Curve crv = explodedCrv[i].DuplicateCurve().Rebuild(2,1, true);
        double totalLength = crv.GetLength();
        double newEndLength = totalLength - shortenAmount;

        if (newEndLength > 0)
        {
            double newEndParameter;
            if (crv.NormalizedLengthParameter(newEndLength / totalLength, out newEndParameter))
            {
                crv = crv.Trim(crv.Domain.T0, newEndParameter);
                shorenedCurves.Add(crv);

            }
        }
    }

    for (int i = 0; i < shorenedCurves.Count; i++){

        if (i > 0)
        {
        // Get the end point of the current curve and the start point of the next curve
        Point3d lastCurveEnd = shorenedCurves[i-1].PointAtEnd;
        Point3d currentCurveStartPoint = shorenedCurves[i].PointAtStart;

        // Calculate the translation vector
        Vector3d translationVector = lastCurveEnd - currentCurveStartPoint;

        // Move the curve so that its end aligns with the start of the next curve
        shorenedCurves[i].Translate(translationVector);
        }
    }

    Curve[] joinedCurve = Curve.JoinCurves(shorenedCurves);

    shCurve = joinedCurve;
# ---------- c_script: C# additional code ----------
// Method to calculate K-Factor
    public static double KFactor(double rw, double t)
    {
        double kfac = 0.65 + (0.5 * Math.Log10(rw / t));
        return kfac;
    }

    // Method to calculate bend shortening
    // Method to calculate bend shortening
    public static double BendShortening(double rw, double t, double a, double k)
    {
        if (a > 180){
            a -= 180;
        }

     if (a > 0)
    {
        if (a < 146)
        {
            if (a < 90)
            {
                return 2 * (rw + t) * Math.Tan(a / 2 / 180 * Math.PI) - Math.PI * (a / 180) * (rw + t / 2 * k);
            }
            else
            {
                return 2 * (rw + t) - Math.PI * (a / 180) * (rw + (t / 2) * k);
            }
        }
        else
        {
            return 2 * (rw + t) - Math.PI * (135.0 / 180.0) * (rw + (t / 2) * k);
        }
    }
    else
    {
        return 0;
    }
    }
    public static double ToDeg(double num){
        return (180/Math.PI)*num;
    }
    public static double ToRad(double num){
        return (Math.PI/180)*num;
    }

    static double[] Shorten(double rw, double t, List<double>angles)
    {

        double k = KFactor(rw, t);

double[] shortFactor = new double[angles.Count];
double[] verkürzung = new double[angles.Count + 1]; // Increased size by 1 to accommodate the extra value in the last iteration

for (int i = 0; i < angles.Count; i++)
{
    double v = BendShortening(rw, t, angles[i], k);
    shortFactor[i] = v / 2;

    if (i == 0)
    {
        verkürzung[i] = v / 2;
    }
    else if (i == angles.Count - 1)
    {
        verkürzung[i] = v / 2 + shortFactor[i - 1];
        verkürzung[i + 1] = shortFactor[i]; // Additional append for the last element
    }
    else
    {
        verkürzung[i] = v / 2 + shortFactor[i - 1];
    }
}

return verkürzung;
    }
# ---------- end c_script ----------
curve = Curve(c_script)

baseprofile_3 = Curve(curve)
t1_3 = Number(t1_2)
addition = Addition(A=t1_3, B=1000)
unit_y_3 = UnitY(Factor=addition)
extrude = Extrude(Base=baseprofile_3, Direction=unit_y_3)
longextrude = Brep(extrude)

baseprofile_4 = Curve(curve)
t1_4 = Number(t1_2)
angle_4 = Number(angle_2)
unit_y_4 = UnitY(Factor=t1_4)
move_9 = Move(Geometry=baseprofile_4, Motion=unit_y_4)  # -> Geometry, Transform
baseprofile_5 = Curve(move_9.Geometry)
explode = Explode(Curve=baseprofile_5, Recursive=True)  # -> Segments, Vertices
list_item = ListItem(List=explode.Vertices, Index=6, Wrap=True)
xy_plane = XYPlane(Origin=list_item)
yz_plane = YZPlane(Origin=list_item)
angle_5 = Number(angle_4)
rotate_3 = Rotate(Geometry=xy_plane, Angle=expr("-x", degrees(angle_5)), Plane=yz_plane)  # -> Geometry, Transform
cuttingplane = Plane(rotate_3.Geometry)

cuttingplane_2 = Plane(cuttingplane)
longextrude_2 = Brep(longextrude)
baseprofile_6 = Curve(curve)
brep_plane = BrepPlane(Brep=longextrude_2, Plane=cuttingplane_2)  # -> Curves, Points
curve_2 = Curve(brep_plane.Curves)
flip_curve = FlipCurve(Curve=curve_2, Guide=baseprofile_6)  # -> Curve, Flag
curve_3 = Curve(flip_curve.Curve)

curve_4 = Curve(curve_3)
number = Number(Slider(10, range=0..10))
explode_2 = Explode(Curve=curve_4, Recursive=True)  # -> Segments, Vertices
panel = Panel("""0
-1""")
number_2 = Number(number)
list_item_2 = ListItem(List=explode_2.Vertices, Index=panel, Wrap=True)
unit_y_5 = UnitY(Factor=number_2)  # -> expr("-x", UnitVector)
list_length = ListLength(List=explode_2.Vertices)  # -> expr("x-1", Length)
move_10 = Move(Geometry=list_item_2, Motion=unit_y_5)  # -> Geometry, Transform
merge_2 = Merge(Data1="0", Data2=list_length)  # -> flatten(Result)
replace_items = ReplaceItems(List=explode_2.Vertices, Item=move_10.Geometry, Indices=merge_2, Wrap=False)
polyline_2 = PolyLine(Vertices=replace_items, Closed=False)
curve_5 = Curve(polyline_2)

curve_6 = Curve(curve_5)
explode_3 = Explode(Curve=curve_6, Recursive=True)  # -> Segments, Vertices
list_item_3 = ListItem(List=explode_3.Segments, Index="5", Wrap=True)
list_item_4 = ListItem(List=explode_3.Segments, Index="4", Wrap=True)
list_item_5 = ListItem(List=explode_3.Segments, Index="3", Wrap=True)
list_item_6 = ListItem(List=explode_3.Segments, Index="2", Wrap=True)
list_item_7 = ListItem(List=explode_3.Segments, Index="1", Wrap=True)
c5 = Curve(list_item_3)
c4 = Curve(list_item_4)
angledvector = Vector(list_item_4)
c3 = Curve(list_item_5)
c2 = Curve(list_item_6)
c1 = Curve(list_item_7)

c5_2 = Curve(c5)
c4_2 = Curve(c4)
llasche1_2 = Number(llasche1)
angledvector_2 = Vector(angledvector)
length = Length(Curve=c4_2)
addition_2 = Addition(A=length, B=llasche1_2)
amplitude = Amplitude(Vector=angledvector_2, Amplitude=addition_2)  # -> expr("-x", Vector)
extrude_2 = Extrude(Base=c5_2, Direction=amplitude)
body2 = Brep(extrude_2)

llasche2_2 = Number(llasche2)

c1_2 = Curve(c1)
angledvector_3 = Vector(angledvector)
amplitude_2 = Amplitude(Vector=angledvector_3, Amplitude=llasche2_2)  # -> expr("-x", Vector)
move_11 = Move(Geometry=c1_2, Motion=amplitude_2)  # -> Geometry, Transform
extend_curve = ExtendCurve(Curve=move_11.Geometry, Type=0, Start=expr("-x", Slider(2, range=0..10)), End=expr("-x", Slider(8, range=0..10)))
merge_3 = Merge(Data1=c1_2, Data2=extend_curve)
loft = Loft(Curves=merge_3, Options={Adjust=False, Closed=False, LoftEnds=0, LoftSimp=0, LoftType=0, Rebuild=10, Refit=0.01})
lasche1_2 = Brep(loft)

lineshortening_3 = Number(lineshortening_2)
lineshortening_4 = Number(lineshortening_2)
number_slider = Slider(10, range=0..10)
lineshortening_5 = Number(lineshortening_2)
number_slider_2 = Slider(1, range=0..10)
group = Group()

curve_7 = Curve(curve_5)
baseprofile_7 = Curve(curve)
explode_4 = Explode(Curve=curve_7, Recursive=True)  # -> Segments, Vertices
explode_5 = Explode(Curve=baseprofile_7, Recursive=True)  # -> Segments, Vertices
cluster = Cluster(list=explode_4.Segments, list_2=explode_4.Segments)

merge_4 = Merge(Data1=simplify(graft(cluster)), Data2=simplify(graft(explode_5.Segments)))

loft_2 = Loft(Curves=merge_4, Options={Adjust=False, Closed=False, LoftEnds=0, LoftSimp=0, LoftType=0, Rebuild=10, Refit=0.01})
brep = Brep(loft_2)

c3_2 = Curve(list_item_5)
angledvector_4 = Vector(list_item_4)
llasche1_3 = Number(llasche1)
amplitude_3 = Amplitude(Vector=angledvector_4, Amplitude=llasche1_3)  # -> expr("-x", Vector)

extend_curve_2 = ExtendCurve(Curve=c3_2, Type=0, Start=lineshortening_3, End=lineshortening_3)

extrude_3 = Extrude(Base=extend_curve_2, Direction=amplitude_3)
body3 = Brep(extrude_3)

llasche3_2 = Number(llasche3)
body3_2 = Brep(body3)
deconstruct_brep = DeconstructBrep(Brep=body3_2)  # -> Faces, Edges, Vertices
list_item_8 = ListItem(List=deconstruct_brep.Edges, Index=0, Wrap=True)
unit_x_6 = UnitX(Factor=llasche3_2)
cl1 = Curve(list_item_8)
move_12 = Move(Geometry=cl1, Motion=expr("-x", unit_x_6))  # -> Geometry, Transform
extend_curve_3 = ExtendCurve(Curve=move_12.Geometry, Type=0, Start=expr("-x", Slider(2, range=0..2)), End=expr("-x", Slider(2, range=0..2)))
merge_5 = Merge(Data1=cl1, Data2=extend_curve_3)
loft_3 = Loft(Curves=merge_5, Options={Adjust=False, Closed=False, LoftEnds=0, LoftSimp=0, LoftType=0, Rebuild=10, Refit=0.01})
lasche2_2 = Brep(loft_3)

mainbody = Brep(flatten(brep))
body2_2 = Brep(body2)
body3_3 = Brep(body3)
lasche1_3 = Brep(lasche1_2)
lasche2_3 = Brep(lasche2_2)
merge_6 = Merge(Data1=mainbody, Data2=body2_2, Data3=body3_3, Data4=lasche1_3, Data5=lasche2_3)  # -> flatten(Result)
brep_join = BrepJoin(Breps=merge_6)  # -> Breps, Closed
unroll_brep = UnrollBrep(Brep=brep_join.Breps, JoinUnrolled="True")
brep_2 = Brep(unroll_brep)

brep_3 = Brep(brep_join.Breps)
custom_preview = CustomPreview(Geometry=brep_3, Material=ColourSwatch(SwatchColor=RGB(214, 176, 129)))

unrolledbody = Brep(brep_2)
unit_x_7 = UnitX(Factor=Slider(500, range=0..1000))
move_13 = Move(Geometry=unrolledbody, Motion=unit_x_7)  # -> Geometry, Transform
unrolledbody_2 = Brep(move_13.Geometry)

unrolledbody_3 = Brep(unrolledbody_2)
deconstruct_brep_2 = DeconstructBrep(Brep=unrolledbody_3)  # -> Faces, Edges, Vertices
curve_8 = Curve(deconstruct_brep_2.Edges)

llasche5_2 = Number(llasche5)
lineshortening_6 = Number(lineshortening_2)

curve_9 = Curve(deconstruct_brep_2.Edges)
list_item_9 = ListItem(List=curve_9, Index=Slider(31, range=0..70), Wrap=True)
llasche4_2 = Number(llasche4)
evaluate_curve = EvaluateCurve(Curve=reparameterize(list_item_9), Parameter=0.5)  # -> Point, Tangent, Angle
unit_z_4 = UnitZ(Factor=llasche4_2)
cross_product = CrossProduct(VectorA=evaluate_curve.Tangent, VectorB=unit_z_4, Unitize=False)  # -> Vector, Length
move_14 = Move(Geometry=list_item_9, Motion=cross_product.Vector)  # -> Geometry, Transform
extend_curve_4 = ExtendCurve(Curve=move_14.Geometry, Type=0, Start="-1", End="-1")
merge_7 = Merge(Data1=list_item_9, Data2=extend_curve_4)
loft_4 = Loft(Curves=merge_7, Options={Adjust=False, Closed=False, LoftEnds=0, LoftSimp=0, LoftType=0, Rebuild=10, Refit=0.01})
radnietloch_3 = Number(radnietloch_2)
deconstruct_brep_3 = DeconstructBrep(Brep=loft_4)  # -> Faces, Edges, Vertices

list_item_10 = ListItem(List=curve_9, Index=Slider(34, range=0..70), Wrap=True)
llasche4_3 = Number(llasche4)
offset_curve = OffsetCurve(Curve=list_item_10, Distance=expr("x/2", llasche4_3), Corners=1)
evaluate_curve_2 = EvaluateCurve(Curve=reparameterize(list_item_10), Parameter=0.5)  # -> Point, Tangent, Angle
unit_z_5 = UnitZ(Factor=1)
list_item_11 = ListItem(List=curve_9, Index=Slider(17, range=0..70), Wrap=True)
curve_middle = CurveMiddle(Curve=offset_curve)
cross_product_2 = CrossProduct(VectorA=evaluate_curve_2.Tangent, VectorB=unit_z_5, Unitize=False)  # -> Vector, Length
end_points = EndPoints(Curve=list_item_10)  # -> Start, End
radnietloch_4 = Number(radnietloch_2)
vector = Vector(list_item_10)
amplitude_4 = Amplitude(Vector=vector, Amplitude=Slider(1, range=0..30))
amplitude_5 = Amplitude(Vector=cross_product_2.Vector, Amplitude=Slider(29, range=0..30))
move_15 = Move(Geometry=end_points.Start, Motion=amplitude_4)  # -> Geometry, Transform
move_16 = Move(Geometry=end_points.End, Motion=amplitude_5)  # -> Geometry, Transform
line = Line(StartPoint=move_15.Geometry, EndPoint=end_points.End)
line_2 = Line(StartPoint=move_15.Geometry, EndPoint=move_16.Geometry)
offset_curve_2 = OffsetCurve(Curve=line_2, Distance=Slider(10, range=0..100), Corners=1)
curve_curve = CurveCurve(CurveA=offset_curve_2, CurveB=list_item_11)  # -> Points, ParamsA, ParamsB
shatter = Shatter(Curve=offset_curve_2, Parameters=curve_curve.ParamsA)
list_item_12 = ListItem(List=shatter, Index=Slider(1, range=0..1), Wrap=True)
extend_curve_5 = ExtendCurve(Curve=list_item_12, Type=0, Start="-1", End="-1")
merge_8 = Merge(Data1=flatten(line_2), Data2=flatten(extend_curve_5))
merge_9 = Merge(Data1=flatten(line), Data2=flatten(line_2))
circle = Circle(Plane=curve_middle, Radius=radnietloch_4)
loft_5 = Loft(Curves=merge_8, Options={Adjust=False, Closed=False, LoftEnds=0, LoftSimp=0, LoftType=0, Rebuild=10, Refit=0.01})
loft_6 = Loft(Curves=merge_9, Options={Adjust=False, Closed=False, LoftEnds=0, LoftSimp=0, LoftType=0, Rebuild=10, Refit=0.01})
brep_join_2 = BrepJoin(Breps=flatten([loft_5, loft_6]))  # -> Breps, Closed
brep_edges = BrepEdges(Brep=brep_join_2.Breps)  # -> Naked, Interior, NonManifold
boundary_surfaces = BoundarySurfaces(Edges=flatten([circle, brep_edges.Naked]))
lasche9 = Brep(boundary_surfaces)

offset_curve_3 = OffsetCurve(Curve=list_item_9, Distance=expr("x/2", llasche4_2), Corners=1)
curve_middle_2 = CurveMiddle(Curve=offset_curve_3)

circle_2 = Circle(Plane=curve_middle_2, Radius=radnietloch_3)
merge_10 = Merge(Data1=flatten(deconstruct_brep_3.Edges), Data2=flatten(circle_2))
boundary_surfaces_2 = BoundarySurfaces(Edges=flatten(merge_10))
lasche4_2 = Brep(boundary_surfaces_2)

list_item_13 = ListItem(List=curve_8, Index=Slider(9, range=0..30), Wrap=True)
list_item_14 = ListItem(List=curve_8, Index=Slider(40, range=0..46), Wrap=True)
list_item_15 = ListItem(List=curve_8, Index=Slider(37, range=0..46), Wrap=True)
list_item_16 = ListItem(List=curve_8, Index=Slider(38, range=0..46), Wrap=True)
end_points_2 = EndPoints(Curve=list_item_15)  # -> Start, End
extend_curve_6 = ExtendCurve(Curve=list_item_13, Type=0, Start=lineshortening_5, End=lineshortening_5)

vector_2 = Vector(list_item_16)
end_points_3 = EndPoints(Curve=list_item_14)  # -> Start, End
amplitude_6 = Amplitude(Vector=vector_2, Amplitude=expr("-x", lineshortening_4))
move_17 = Move(Geometry=end_points_3.Start, Motion=amplitude_6)  # -> Geometry, Transform
line_3 = Line(StartPoint=move_17.Geometry, EndPoint=end_points_2.End)
extend_curve_7 = ExtendCurve(Curve=line_3, Type=0, Start=lineshortening_5, End=lineshortening_5)

merge_11 = Merge(Data1=extend_curve_6, Data2=extend_curve_7)
loft_7 = Loft(Curves=merge_11, Options={Adjust=False, Closed=False, LoftEnds=0, LoftSimp=0, LoftType=0, Rebuild=10, Refit=0.01})
lasche5_2 = Brep(loft_7)

curve_10 = Curve(deconstruct_brep_2.Edges)
list_item_17 = ListItem(List=curve_10, Index=Slider(24, range=0..46), Wrap=True)
list_item_18 = ListItem(List=curve_10, Index=Slider(30, range=0..46), Wrap=True)
list_item_19 = ListItem(List=curve_10, Index=Slider(30, range=0..46), Wrap=True)
llasche5_3 = Number(llasche5)
offset_curve_4 = OffsetCurve(Curve=list_item_17, Distance=llasche5_3, Corners=1)
offset_curve_5 = OffsetCurve(Curve=list_item_19, Distance=llasche5_3, Corners=1)
curve_curve_2 = CurveCurve(CurveA=offset_curve_4, CurveB=list_item_18)  # -> Points, ParamsA, ParamsB
length_2 = Length(Curve=offset_curve_4)
subtraction = Subtraction(A=length_2, B=curve_curve_2.ParamsA)
merge_12 = Merge(Data1=subtraction, Data2=curve_curve_2.ParamsA)  # -> flatten(Result)
shatter_2 = Shatter(Curve=offset_curve_5, Parameters=merge_12)
list_item_20 = ListItem(List=shatter_2, Index="1", Wrap=True)
lineshortening_7 = Number(lineshortening_2)

number_slider_3 = Slider(24, range=0..46)
list_item_21 = ListItem(List=curve_10, Index=number_slider_3, Wrap=True)
llasche5_4 = Number(llasche5)
number_slider_4 = Slider(3, range=0..10)
offset_curve_6 = OffsetCurve(Curve=list_item_21, Distance=expr("-x/2", llasche5_4), Corners=1)
divide_curve = DivideCurve(Curve=offset_curve_6, Count=number_slider_4, Kinks=False)  # -> Points, Tangents, Parameters
panel_2 = Panel("""0
-1""")
cull_index = CullIndex(List=divide_curve.Points, Indices=panel_2, Wrap=True)
radnietloch_5 = Number(radnietloch_2)
circle_3 = Circle(Plane=cull_index, Radius=radnietloch_5)

number_slider_5 = Slider(30, range=0..46)
length_3 = Length(Curve=list_item_21)
list_item_22 = ListItem(List=curve_10, Index=number_slider_5, Wrap=True)
shatter_3 = Shatter(Curve=list_item_22, Parameters=length_3)
number_slider_6 = Slider(3, range=0..10)
list_item_23 = ListItem(List=shatter_3, Index=0, Wrap=True)
llasche5_5 = Number(llasche5)
offset_curve_7 = OffsetCurve(Curve=list_item_23, Distance=expr("x/2", llasche5_5), Corners=1)
divide_curve_2 = DivideCurve(Curve=offset_curve_7, Count=number_slider_6, Kinks=False)  # -> Points, Tangents, Parameters
panel_3 = Panel("""0
-1""")
cull_index_2 = CullIndex(List=divide_curve_2.Points, Indices=panel_3, Wrap=True)
radnietloch_6 = Number(radnietloch_2)
circle_4 = Circle(Plane=cull_index_2, Radius=radnietloch_6)

shatter_4 = Shatter(Curve=list_item_19, Parameters=length_2)
llasche5_6 = Number(llasche5)
list_item_24 = ListItem(List=shatter_4, Index="0", Wrap=True)
list_item_25 = ListItem(List=shatter_4, Index="1", Wrap=True)
offset_curve_8 = OffsetCurve(Curve=list_item_25, Distance=llasche5_6, Corners=1)
negative = Negative(Value=llasche5_6)
negative_2 = Negative(Value="2")
extend_curve_8 = ExtendCurve(Curve=list_item_25, Type=0, Start=negative_2, End=negative_2)
extend_curve_9 = ExtendCurve(Curve=offset_curve_8, Type=0, Start=negative, End=negative)
merge_13 = Merge(Data1=flatten(extend_curve_8), Data2=flatten(extend_curve_9))
loft_8 = Loft(Curves=merge_13, Options={Adjust=False, Closed=False, LoftEnds=0, LoftSimp=0, LoftType=0, Rebuild=10, Refit=0.01})
lasche7 = Brep(loft_8)

merge_14 = Merge(Data1=flatten(list_item_24), Data2=flatten(list_item_20))
extend_curve_10 = ExtendCurve(Curve=merge_14, Type=0, Start=lineshortening_7, End=lineshortening_7)
loft_9 = Loft(Curves=extend_curve_10, Options={Adjust=False, Closed=False, LoftEnds=0, LoftSimp=0, LoftType=0, Rebuild=10, Refit=0.01})
lasche6 = Brep(loft_9)

list_item_26 = ListItem(List=curve_9, Index=Slider(28, range=0..70), Wrap=True)
extend_curve_11 = ExtendCurve(Curve=list_item_26, Type=0, Start="-2", End="-2")
list_item_27 = ListItem(List=curve_9, Index=Slider(17, range=0..70), Wrap=True)
offset_curve_9 = OffsetCurve(Curve=extend_curve_11, Distance=llasche5_2, Corners=1)
length_4 = Length(Curve=offset_curve_9)
extend_curve_12 = ExtendCurve(Curve=extend_curve_11, Type=0, Start=lineshortening_6, End=lineshortening_6)

extend_curve_13 = ExtendCurve(Curve=offset_curve_9, Type=0, Start=number_slider, End=number_slider)

offset_curve_10 = OffsetCurve(Curve=list_item_26, Distance=expr("x/2", llasche5_2), Corners=1)
number_slider_7 = Slider(3, range=0..10)
divide_curve_3 = DivideCurve(Curve=offset_curve_10, Count=number_slider_7, Kinks=False)  # -> Points, Tangents, Parameters
panel_4 = Panel("""0
-1""")
cull_index_3 = CullIndex(List=divide_curve_3.Points, Indices=panel_4, Wrap=True)
radnietloch_7 = Number(radnietloch_2)
circle_5 = Circle(Plane=cull_index_3, Radius=radnietloch_7)

offset_curve_11 = OffsetCurve(Curve=list_item_27, Distance=expr("-x/2", llasche5_2), Corners=1)
number_slider_8 = Slider(3, range=0..10)
divide_curve_4 = DivideCurve(Curve=offset_curve_11, Count=number_slider_8, Kinks=False)  # -> Points, Tangents, Parameters
panel_5 = Panel("""0
-1""")
cull_index_4 = CullIndex(List=divide_curve_4.Points, Indices=panel_5, Wrap=True)
radnietloch_8 = Number(radnietloch_2)
circle_6 = Circle(Plane=cull_index_4, Radius=radnietloch_8)

merge_15 = Merge(Data1=flatten(circle_5), Data2=flatten(circle_6), Data3=flatten(circle_3), Data4=flatten(circle_4))
curve_11 = Curve(merge_15)

curve_curve_3 = CurveCurve(CurveA=extend_curve_13, CurveB=list_item_27)  # -> Points, ParamsA, ParamsB

addition_3 = Addition(A=curve_curve_3.ParamsA, B="-2")

subtraction_2 = Subtraction(A=length_4, B=addition_3)
merge_16 = Merge(Data1=subtraction_2, Data2=addition_3)
shatter_5 = Shatter(Curve=offset_curve_9, Parameters=merge_16)
list_item_28 = ListItem(List=shatter_5, Index="1", Wrap=True)
extend_curve_14 = ExtendCurve(Curve=list_item_28, Type=0, Start=lineshortening_6, End=lineshortening_6)
merge_17 = Merge(Data1=flatten(extend_curve_12), Data2=flatten(extend_curve_14))
loft_10 = Loft(Curves=merge_17, Options={Adjust=False, Closed=False, LoftEnds=0, LoftSimp=0, LoftType=0, Rebuild=10, Refit=0.01})
lasche8 = Brep(loft_10)

unrolledbody_4 = Brep(unrolledbody_2)
lasche4_3 = Brep(lasche4_2)
lasche5_3 = Brep(lasche5_2)
lasche6_2 = Brep(lasche6)
lasche7_2 = Brep(lasche7)
lasche8_2 = Brep(lasche8)
lasche9_2 = Brep(lasche9)
merge_18 = Merge(
    Data1=unrolledbody_4,
    Data2=lasche4_3,
    Data3=lasche5_3,
    Data4=lasche6_2,
    Data5=lasche7_2,
    Data6=lasche8_2,
    Data7=lasche9_2)  # -> flatten(Result)
brep_join_3 = BrepJoin(Breps=merge_18)  # -> Breps, Closed

brep_edges_2 = BrepEdges(Brep=brep_join_3.Breps)  # -> Naked, Interior, NonManifold
join_curves = JoinCurves(Curves=brep_edges_2.Naked, Preserve=False)
curve_12 = Curve(curve_11)
curve_13 = Curve(brep_edges_2.Interior)

explode_6 = Explode(Curve=join_curves, Recursive=True)  # -> Segments, Vertices
custom_preview_lineweights = CustomPreviewLineweights(Geometry=curve_13, Shader=ColourSwatch(SwatchColor=RGB(92, 247, 255)), Thickness=number_slider_2, Absolute=False)

merge_19 = Merge(Data1=flatten(explode_6.Segments), Data2=flatten(curve_12))

curve_14 = Curve(merge_19)

boundary_surfaces_3 = BoundarySurfaces(Edges=curve_14)
brep_4 = Brep(boundary_surfaces_3)

brep_edges_3 = BrepEdges(Brep=brep_4)  # -> flatten(Naked), Interior, NonManifold
join_curves_2 = JoinCurves(Curves=brep_edges_3.Naked, Preserve=False)
custom_preview_lineweights_2 = CustomPreviewLineweights(Geometry=join_curves_2, Shader=ColourSwatch(SwatchColor=RGB(166, 255, 0)), Thickness=number_slider_2, Absolute=False)

# ==== cluster Cluster
panel = Panel("""6
7""")
list = ClusterInput()
list_item = ListItem(List=list, Index=panel, Wrap=True)
unit_y = UnitY(Factor="-0.2")
move = Move(Geometry=list_item, Motion=unit_y)  # -> Geometry, Transform
list_2 = ClusterInput()
replace_items = ReplaceItems(List=list_2, Item=move.Geometry, Indices=panel, Wrap=False)
list_3 = ClusterOutput(replace_items)
