# Grasshopper definition test_gh.gh (Grasshopper 1.0.7)
# Copyright: Felix Brunold

construct_point = ConstructPoint(XCoordinate=Slider(0.25, range=0..1), YCoordinate=Slider(0.467, range=0..1), ZCoordinate=Slider(0.575, range=0..1))
